# Grasshopper definition wall.gh (Grasshopper 1.0.8)

pt = Point(Point(5.001711985, -8.673772811, 0))
pt_2 = Point(Point(7.947823595, -6.552102731, 0))
pt_3 = Point(Point(3.17893002, -6.599816486, 0))
c_script = CSharpScript(p0=pt, p1=pt_2, p2=pt_3, d0=Slider(0.19, range=0.01..1), d1=Slider(0.28, range=0.02..1))  # -> out, a; inputs p0: Point3d, p1: Point3d, p2: Point3d, d0: Double, d1: Double
# ---------- c_script: C# ----------
// Grasshopper Script Instance
#region Usings
using System;
using System.Linq;
using System.Collections;
using System.Collections.Generic;
using System.Drawing;

using Rhino;
using Rhino.Geometry;

using Grasshopper;
using Grasshopper.Kernel;
using Grasshopper.Kernel.Data;
using Grasshopper.Kernel.Types;
#endregion

public class Script_Instance : GH_ScriptInstance
{
    #region Notes
    /* 
      Members:
        RhinoDoc RhinoDocument
        GH_Document GrasshopperDocument
        IGH_Component Component
        int Iteration

      Methods (Virtual & overridable):
        Print(string text)
        Print(string format, params object[] args)
        Reflect(object obj)
        Reflect(object obj, string method_name)
    */
    #endregion

    private void RunScript(
		Point3d p0,
		Point3d p1,
		Point3d p2,
		double d0,
		double d1,
		ref object a)
    {
        //
List<object> A=new List<object >();
        //
     Line l0=new Line(p0,p1);
     Line l1=new Line(p0,p2);

  var clod0=offictopolyline(l0,d0);
  var clod1=offictopolyline(l1,d1);
//
 var pts0 = curvepoint(clod0);
 var pts1 = curvepoint(clod1);
 var b0 = pdzbz(pts0, clod1, out var plei0);
 var b1 = pdzbz(pts1, clod0, out var plei1);
 var pm0 = new Point3d();
 var pm1 = new Point3d();
 var pjiao = new Point3d();
 List<Point3d> ptsbhe = new List<Point3d>();
 Curve jiao = null;
// Brep a = new Brep();
 Brep[] c = new Brep[1];
 var bs = new List<Brep>();
//
if(b0&&b1)
{
    Transform tran= Transform.Rotation(Math.PI,p0);
    plei0.Transform(tran);
    plei1.Transform(tran);
    Transform tran0=Transform.Translation(p0-p1);
    Transform tran1=Transform.Translation(p0-p2);
    pm0= plei0;
    pm1= plei1;
   pm0.Transform(tran0);
   pm1.Transform(tran1);
 pjiao = lineline(new Line(plei0, pm0), new Line(plei1, pm1));
 ptsbhe.Add(pjiao);
 ptsbhe.Add(plei0);
 ptsbhe.Add(p0);
 ptsbhe.Add(plei1);
 jiao = NurbsCurve.Create(true, 1, ptsbhe);
}




//
//A.Add(l0);
//A.Add(l1);
A.Add(clod0);
A.Add(clod1);
//A.Add(b0&&b1);
//A.Add(plei0);
//A.Add(plei1);
//A.Add(pm0);
////A.Add(pm1);
A.Add(jiao);


//
a=A;
    }
    public Curve offic(Line C,double D)
{
    
    // Compute the offset (might not be a single continuous curve)
    Curve[] offsets = C.ToNurbsCurve().Offset(Plane.WorldXY, D, 0.0001, (CurveOffsetCornerStyle) 1);

    // Try to join the result
    Curve[] joint = Curve.JoinCurves(offsets);

    // Figure out which one to output
    Curve[] result = joint == null ? offsets : joint;
    Curve c=result[0];
    return c;
}
public Curve offictopolyline(Line c,double d)
{
  var l1=offic(c,d);
  var l2=offic(c,-d);
  List<Point3d>pts=new List<Point3d >();
  pts.Add(l1.ControlPolygon().First());
  pts.Add(l1.ControlPolygon().Last());
   pts.Add(l2.ControlPolygon().Last());
  pts.Add(l2.ControlPolygon().First());

  var polyline = NurbsCurve.Create(true,1,pts);
  return polyline.ToNurbsCurve();
}
public bool pdzbz(List<Point3d> pts,Curve C,out Point3d pout)
{
    pout=new Point3d();
    bool b=false;
    int m=0;
   for(int i=0;i<pts.Count;i++)
   {
    if(pz(pts[i],C))
    {
     m++;
     pout=pts[i];
    }
   }
   if(m==1)
   {
    b=true;

    }
   return b;
}
public bool pz(Point3d P,Curve C)
{
      Plane pln = new Plane();
    bool xy = C.TryGetPlane(out pln);
    if(!xy) pln = Plane.WorldXY;
    //Plane.FitPlaneToPoints(pts, out pln);

    // Test for containment, need to specify plane
    // Will not match GH output unless defined plane of curve is correct
    PointContainment inside = C.Contains(P, pln, Rhino.RhinoDoc.ActiveDoc.ModelAbsoluteTolerance);

    // Change output value to match GH output
    int intValue = (int) inside;
    switch(intValue){
      case 2:
        intValue = 0;
        break;
      case 1:
        intValue = 2;
        break;
      case 3:
        intValue = 1;
        break;
    }
    bool b=false;
    if(intValue==2)
     {
    b=true;
     }
    return b;
}
public List<Point3d> curvepoint(Curve C)
{
     List<Point3d> Points = new List<Point3d>();

    for (int i = 0, n = C.ToNurbsCurve().Points.Count; i < n; i++)
    {
      Point3d temp = new Point3d(C.ToNurbsCurve().Points[i].X, C.ToNurbsCurve().Points[i].Y, C.ToNurbsCurve().Points[i].Z);

      //Let's add this temp to our point list.
      Points.Add(temp);
    }
    Points.RemoveAt(0);
    return Points;
}
       public Point3d lineline(Line A, Line B)
       {
           bool success = Rhino.Geometry.Intersect.Intersection.LineLine
          (A, B, out var paramA, out var paramB);


           var pointA = A.PointAt(paramA);
           return pointA;

       }
}
# ---------- end c_script ----------
runion = RegionUnion(Curves=c_script.a)
panel = Panel(c_script.a)
cpoly = ControlPolygon()  # -> Polygon, Points
